test file "RollRefCumulativeCovTest"

suite "Cumulative coverage test suite"

  case "New Test Case 1" [baseline]
    model RollAutopilotRevised, harness RollReference_LoggedDataTest (for RollAutopilotRevised/Roll Reference)
    input "Test Case:1" from Roll_sldvdata.mat (active)
    input "Design Verifier (Roll_sldvdata.mat)" from Roll_sldvdata.mat
    custom criteria (off):
      % Return value: customCriteria
      % set customCriteria.out to true for pass and false for fail
      % set customCriteria.logs (cell array) for log messages
      % set customCriteria.errors (cell array) for error messages

      customCriteria.out = true;
    iteration script:
      %% Iterate over all External Inputs.

      % Determine the number of possible iterations
      numSteps = length(sltest_externalInputs);

      % Create each iteration
      for k = 1 : numSteps
          % Set up a new iteration object
          testItr = sltestiteration();

          % Set iteration settings
          setTestParam(testItr, 'ExternalInput', sltest_externalInputs{k});

          % Register the iteration to run in this test case
          addIteration(sltest_testCase, testItr); % You can pass in an optional iteration name
      end
    TableIterations:
      TableIteration:
        Enabled: true
        Name: Iteration1
        propertyList:
          ConfigurationSet1: PropertyName: Configuration Set; IsDefault: true; SimulationIndex: 1
          SignalBuilderGroup1: PropertyName: Signal Builder Group; IsDefault: true; SimulationIndex: 1
          ParameterSet1: PropertyName: Parameter Set; IsDefault: true; SimulationIndex: 1
          ExternalInputs1: PropertyName: External Inputs; Value: Test Case:1; SimulationIndex: 1
          Baseline1: PropertyName: Baseline; IsDefault: true; SimulationIndex: 1

  case "RollReference Timeseries Input" [simulation]
    model RollAutopilotRevised, harness RollReference_LoggedDataTest (for RollAutopilotRevised/Roll Reference)
    custom criteria (off): same code as in custom criteria (off) of case "New Test Case 1"