test file "sltestProjectorCtrlTests"

suite "Model baseline tests"
  setup callback:
    open_system(fullfile(matlabroot,'toolbox','simulinktest','simulinktestdemos','sltestProjectorController'));
    set_param('sltestProjectorController','SystemTargetFile','ert.tlc');
  cleanup callback:
    close_system('sltestProjectorController',0);

  case "Req_scenario_1" [baseline]
    model sltestProjectorController, harness Req_scenario_1
    baseline "sltestProjectorCtrlData1.mat"
      fan_on
      fan_speed
      lamp_on
    custom criteria (off):
      % Return value: customCriteria
      % set customCriteria.out to true for pass and false for fail
      % set customCriteria.logs (cell array) for log messages
      % set customCriteria.errors (cell array) for error messages

      customCriteria.out = true;

  case "Req_scenario_2" [baseline]
    model sltestProjectorController, harness Req_scenario_2
    baseline "sltestProjectorCtrlData2.mat"
      fan_on
      fan_speed
      lamp_on
    custom criteria (off): same code as in custom criteria (off) of case "Req_scenario_1"

  case "Req_scenario_3" [baseline]
    model sltestProjectorController, harness Req_scenario_3
    baseline "sltestProjectorCtrlData3.mat"
      fan_on
      fan_speed
      lamp_on
    custom criteria (off): same code as in custom criteria (off) of case "Req_scenario_1"

  case "Req_scenario_4" [baseline]
    model sltestProjectorController, harness Req_scenario_4
    baseline "sltestProjectorCtrlData4.mat"
      fan_on
      fan_speed
      lamp_on
    custom criteria (off): same code as in custom criteria (off) of case "Req_scenario_1"

suite "Real time tests"
  setup callback:
    open_system(fullfile(matlabroot,'toolbox','simulinktest','simulinktestdemos','sltestProjectorController'));
    set_param('sltestProjectorController','SystemTargetFile','slrt.tlc');
  cleanup callback:
    close_system('sltestProjectorController',0);

  case "Real time baseline scenario 1" [real-time]
    model sltestProjectorController, harness Req_scenario_1
    baseline "sltestProjectorCtrlData1.mat"
      fan_on
      fan_speed
      lamp_on
    custom criteria (off): same code as in custom criteria (off) of case "Req_scenario_1"

  case "Real time baseline scenario 2" [real-time]
    model sltestProjectorController, harness Req_scenario_2
    baseline "sltestProjectorCtrlData2.mat"
      fan_on
      fan_speed
      lamp_on
    custom criteria (off): same code as in custom criteria (off) of case "Req_scenario_1"

  case "Real time baseline scenario 3" [real-time]
    model sltestProjectorController, harness Req_scenario_3
    baseline "sltestProjectorCtrlData3.mat"
      fan_on
      fan_speed
      lamp_on
    custom criteria (off): same code as in custom criteria (off) of case "Req_scenario_1"

  case "Real time baseline scenario 4" [real-time]
    model sltestProjectorController, harness Req_scenario_4
    baseline "sltestProjectorCtrlData4.mat"
      fan_on
      fan_speed
      lamp_on
    custom criteria (off): same code as in custom criteria (off) of case "Req_scenario_1"