test file "sltestProjectorFanSpeedTestSuite"

suite "Fan Speed Parametric Study"

  case "Fan Speed = 800" [baseline]
    model sltestProjectorFanSpeedExample, harness FanSpeedTestHarness
    parameter set "Parameter Set 1": Fan_Flow = Fan_Speed*(Fan_Air_Displacement/60)*Cp;  % base workspace

  case "Fan Speed = 1300" [baseline]
    model sltestProjectorFanSpeedExample, harness FanSpeedTestHarness
    parameter set "Parameter Set 1": Fan_Flow = Fan_Speed*(Fan_Air_Displacement/60)*Cp;  % base workspace

  case "Fan Speed = 1800" [baseline]
    model sltestProjectorFanSpeedExample, harness FanSpeedTestHarness
    parameter set "Parameter Set 1": Fan_Flow = Fan_Speed*(Fan_Air_Displacement/60)*Cp;  % base workspace

  case "Fan Speed = 2300" [baseline]
    model sltestProjectorFanSpeedExample, harness FanSpeedTestHarness
    parameter set "Parameter Set 1": Fan_Flow = Fan_Speed*(Fan_Air_Displacement/60)*Cp;  % base workspace